# Dynamo graph Create Filters using Excel.dyn (Dynamo 2.19.3.6394)
# packages: Data-Shapes 2025.3.119

# group: Select Excel File
string = StringInput("Select Excel File")
filepath_data = Custom[FilePath Data](ButtonText=string)  # package Data-Shapes; Create filepath input for UI.MultipleInputForm ++ . Check out www.data-shapes.net for more infos !

# group: DropDown Type Rule Raw
string_2 = StringInput("Type of Rule")
string_3 = StringInput("Equal")
string_4 = StringInput("Does Not Equal")
string_5 = StringInput("Contains")
string_6 = StringInput("Does Not Contain")
list_create = List.Create(item0=string_3, item1=string_4, item2=string_5, item3=string_6)
string_7 = StringInput("equals")
string_8 = StringInput("not_equals")
string_9 = StringInput("contains")
string_10 = StringInput("not_contains")
list_create_2 = List.Create(item0=string_7, item1=string_8, item2=string_9, item3=string_10)
number = DoubleInput(0)
dropdown_data = Custom[DropDown Data](InputName=string_2, Keys=list_create, Values=list_create_2, DefaultValueIndex=number)  # package Data-Shapes; Create data for DropDown input in UI.MultiInputForm ++ . Check out www.data-shapes.net for more infos.

# group: List View Categorires
code_block = CodeBlock { "Conduits"; "Conduit Fittings"; "Cable Trays"; "Cable Trays Fittings"; }
list_create_3 = List.Create(item0=code_block.out0, item1=code_block.out1, item2=code_block.out2, item3=code_block.out3)
categories = Categories("OST_Conduit")
categories_2 = Categories("OST_ConduitFitting")
categories_3 = Categories("OST_CableTray")
categories_4 = Categories("OST_CableTrayFitting")
list_create_4 = List.Create(item0=categories, item1=categories_2, item2=categories_3, item3=categories_4)
listview_data = Custom[Listview Data](Keys=list_create_3, Values=list_create_4)  # package Data-Shapes; Create data for ListView input in UI.MultiInputForm ++ . Check out www.data-shapes.net for more infos.

# group: DropDown Parameters
string_11 = StringInput("Choose Parameter")
code_block_2 = CodeBlock()
# ---------- code_block_2.designscript (37 lines) ----------
"Comments";
"Description";
"Diameter(Trade Size)";
"Exchange ID";
"Family Name";
"Inside Diameter";
"Keynote";
"Length";
"Lower End Bottom Elevation";
"Lower End Centerline Elevation";
"Lower End Top Elevation";
"Outside Diameter";
"Service Type";
"Size";
"SJS_Amperage";
"SJS Circuit";
"SJS_Conduit Check";
"SJS Conduit Count";
"SJS_Conduit Element Length";
"SJS_Conduit Run Length";
"SJS Conduit Size";
"SJS Conduit ID";
"SJS Destination";
"SJS_Feeder Tag";
"SJS Ground Size";
"SJS Level";
"SJS Neutral Size";
"SJS_Origin";
"SJS_System";
"SJS_Voltage";
"SJS Wire Count";
"SJS_Wire Size";
"SJS_Wire Type";
"Upper End Bottom Elevation";
"Upper End Centerline Elevation";
"Upper End Top Elevation";
"Workset";
# ----------------------------------------
list_create_5 = List.Create(item0=code_block_2.out0, item1=code_block_2.out1, item2=code_block_2.out2, item3=code_block_2.out3, item4=code_block_2.out4, item5=code_block_2.out5, item6=code_block_2.out6, item7=code_block_2.out7, item8=code_block_2.out8, item9=code_block_2.out9, item10=code_block_2.out10, item11=code_block_2.out11, item12=code_block_2.out12, item13=code_block_2.out13, item14=code_block_2.out14, item15=code_block_2.out15, item16=code_block_2.out16, item17=code_block_2.out17, item18=code_block_2.out18, item19=code_block_2.out19, item20=code_block_2.out20, item21=code_block_2.out21, item22=code_block_2.out22, item23=code_block_2.out23, item24=code_block_2.out24, item25=code_block_2.out25, item26=code_block_2.out26, item27=code_block_2.out27, item28=code_block_2.out28, item29=code_block_2.out29, item30=code_block_2.out30, item31=code_block_2.out31, item32=code_block_2.out32, item33=code_block_2.out33, item34=code_block_2.out34, item35=code_block_2.out35, item36=code_block_2.out36)
number_2 = DoubleInput(0)
dropdown_data_2 = Custom[DropDown Data](InputName=string_11, Keys=list_create_5, Values=list_create_5, DefaultValueIndex=number_2)

# group: Checkbox Deliverable View
boolean = BoolSelector(false)
string_12 = StringInput("Add 'DV-' prefix to filter names?")
boolean_input = Custom[Boolean input](DefaultValue=boolean, SideText=string_12)  # package Data-Shapes; Creates a boolean input for UI.MultipleInputForm ++ . Check out www.data-shapes.net for more infos!

# group: UI Box
file_path = Filename(".\Filters Create.jpeg")  # graph input
image_data = Custom[Image Data](Image=file_path)  # package Data-Shapes; Places an image on UI.MultipleInutForm ++ .
string_13 = StringInput("Next")
list_create_6 = List.Create(item0=filepath_data, item1=dropdown_data, item2=listview_data, item3=dropdown_data_2, item4=boolean_input)
boolean_2 = BoolSelector(true)
string_14 = StringInput("Cancel")
number_3 = DoubleInput(500)
multipleinputform = Custom[MultipleInputForm ++](Logo_optional=image_data, ButtonText_optional=string_13, Inputs=list_create_6, Toggle=boolean_2, CancelButtonText_optional=string_14, Width_optional=number_3)  # package Data-Shapes; Create a form with multiple inputs. see www.data-shapes.net for tutorials and infos!

# group: Extract data from excel
number_4 = DoubleInput(0)
getItemAtIndex = List.GetItemAtIndex(list=multipleinputform.User_Inputs, index=number_4)
file_from_path = FileObject(path=getItemAtIndex)
string_15 = StringInput("Plan1")
boolean_3 = BoolSelector(false)
importExcel = Data.ImportExcel(file=file_from_path, sheetName=string_15, showExcel=boolean_3)

# group: Creating the Valor+Cor dictionary
restOfItems = List.RestOfItems(list=importExcel)
transpose = List.Transpose(lists=restOfItems)
number_5 = DoubleInput(0)
getItemAtIndex_2 = List.GetItemAtIndex(list=transpose, index=number_5)
string_from_object = FromObject(object=getItemAtIndex_2)
number_6 = DoubleInput(1)
getItemAtIndex_3 = List.GetItemAtIndex(list=transpose, index=number_6)
string_16 = StringInput(",")
split = String.Split(string=getItemAtIndex_3, separator0=string_16)
toNumber = String.ToNumber(string=split)
transpose_2 = List.Transpose(lists=toNumber)
firstItem = List.FirstItem(list=transpose_2)
number_7 = DoubleInput(1)
getItemAtIndex_4 = List.GetItemAtIndex(list=transpose_2, index=number_7)
lastItem = List.LastItem(list=transpose_2)
byARGB = Color.ByARGB(red=firstItem, green=getItemAtIndex_4, blue=lastItem)

# group: Inputs
byKeysValues = DesignScript.Builtin.Dictionary.ByKeysValues(keys=string_from_object, values=byARGB)
number_8 = DoubleInput(3)
getItemAtIndex_5 = List.GetItemAtIndex(list=multipleinputform.User_Inputs, index=number_8)
number_9 = DoubleInput(2)
getItemAtIndex_6 = List.GetItemAtIndex(list=multipleinputform.User_Inputs, index=number_9)
current = Document.Current()
activeView = Document.ActiveView(document=current)
number_10 = DoubleInput(1)
getItemAtIndex_7 = List.GetItemAtIndex(list=multipleinputform.User_Inputs, index=number_10)
number_11 = DoubleInput(4)
getItemAtIndex_8 = List.GetItemAtIndex(list=multipleinputform.User_Inputs, index=number_11)

# group: Extract the Parameter ID
categories_5 = Categories("OST_Conduit")
all_elements_of_category = ElementsOfCategory(Category=categories_5)
number_12 = DoubleInput(0)
getItemAtIndex_9 = List.GetItemAtIndex(list=all_elements_of_category, index=number_12)
python_script = Python(IN[0]=getItemAtIndex_9, IN[1]=getItemAtIndex_5)  # IronPython2
# ---------- python_script.python (36 lines) ----------
import clr
clr.AddReference('RevitAPI')
from Autodesk.Revit.DB import *

clr.AddReference('RevitServices')
import RevitServices
from RevitServices.Persistence import DocumentManager

# Pega as entradas do Dynamo
elements = UnwrapElement(IN[0])
paramName = IN[1]

# Lista para guardar o resultado
output_id = []

# O Id de um parâmetro de projeto/compartilhado é o mesmo para todos os elementos,
# então só precisamos verificar o primeiro item da lista.
if elements:
    # Garante que a entrada seja uma lista para pegar o primeiro item
    if not isinstance(elements, list):
        elements = [elements]
    
    first_element = elements[0]
    
    # Procura o parâmetro pelo nome no primeiro elemento
    param = first_element.LookupParameter(paramName)
    
    if param:
        # Se encontrou, pega o Id DO PARÂMETRO
        parameter_id = param.Id
        output_id.append(parameter_id)
    else:
        output_id.append("Parâmetro nao encontrado")

# Envia o Id para a saída
OUT = output_id
# ----------------------------------------

# group (continued): Inputs
firstItem_2 = List.FirstItem(list=python_script)

# group: Output
python_script_2 = Python(IN[0]=byKeysValues, IN[1]=firstItem_2, IN[2]=getItemAtIndex_6, IN[3]=activeView, IN[4]=getItemAtIndex_5, IN[5]=getItemAtIndex_7, IN[6]=getItemAtIndex_8)  # IronPython2
# ---------- python_script_2.python (132 lines) ----------
import clr

# --- References ---
clr.AddReference('RevitAPI'); from Autodesk.Revit.DB import *
clr.AddReference('RevitServices'); import RevitServices
from RevitServices.Persistence import DocumentManager
from RevitServices.Transactions import TransactionManager
clr.AddReference('System'); from System.Collections.Generic import List
clr.AddReference('System.Windows.Forms'); from System.Windows.Forms import MessageBox, MessageBoxButtons, MessageBoxIcon

# --- Dynamo Inputs ---
value_color_map = IN[0]
parameter_id = IN[1]
categories_to_filter = IN[2]
target_view = UnwrapElement(IN[3])
parameter_name = IN[4]
type_rule_raw = IN[5]
add_prefix = IN[6] # Boolean value from the UI checkbox

doc = DocumentManager.Instance.CurrentDBDocument
action_log = []
filters_created_count = 0
filters_applied_count = 0

# --- DICTIONARY FOR CATEGORY PREFIXES ---
category_prefix_map = {
    "Conduits": "CND",
    "Conduit Fittings": "CNDF",
    "Cable Trays": "CT",
    "Cable Tray Fittings": "CTF"
}

# --- Rule Dictionaries ---
input_alias_map = {
    "equals": "Equals", "not_equals": "Does not equal", "does not equal": "Does not equal",
    "contains": "Contains", "not_contains": "Does not contain", "does not contain": "Does not contain"
}
rule_map = {
    "Equals": (ParameterFilterRuleFactory.CreateEqualsRule, "=="),
    "Does not equal": (ParameterFilterRuleFactory.CreateNotEqualsRule, "=/="),
    "Contains": (ParameterFilterRuleFactory.CreateContainsRule, "(==)"),
    "Does not contain": (ParameterFilterRuleFactory.CreateNotContainsRule, "(=/=)")
}

# --- PRE-PROCESSING STAGE ---
user_input_raw = type_rule_raw.strip().lower()
rule_choice = input_alias_map.get(user_input_raw)

if rule_choice is None:
    action_log.append("FATAL ERROR: Invalid rule choice provided: '{}'.".format(type_rule_raw))
    OUT = action_log
else:
    rule_function, rule_symbol = rule_map[rule_choice]
    
    collector_filters = FilteredElementCollector(doc).OfClass(ParameterFilterElement)
    existing_filters = {f.Name: f for f in collector_filters}

    # --- CORRECTED: ROBUST METHOD TO FIND SOLID FILL PATTERN ---
    solid_fill_id = None
    collector_patterns = FilteredElementCollector(doc).OfClass(FillPatternElement)
    for pattern in collector_patterns:
        if pattern.GetFillPattern().IsSolidFill:
            solid_fill_id = pattern.Id
            break
    
    if not isinstance(categories_to_filter, list): categories_to_filter = [categories_to_filter]

    # Prepare the full list of category IDs once
    try:
        list_ids_categories_net = List[ElementId]([ElementId(c.Id) for c in categories_to_filter])
    except:
        list_ids_categories_net = List[ElementId]([c.InternalElement.Id for c in categories_to_filter])
        
    # Build the concatenated name prefix before the main loop
    name_parts = []
    for category_obj in categories_to_filter:
        prefix = category_prefix_map.get(category_obj.Name, "GEN")
        name_parts.append('{}-{}'.format(category_obj.Name, prefix))
    concatenated_prefix = ' & '.join(name_parts)

    TransactionManager.Instance.EnsureInTransaction(doc)
    try:
        if solid_fill_id is None:
            action_log.append("ERROR: Could not find the 'Solid fill' pattern in the project.")
        else:
            # Main loop for each item in the Excel file
            for value_name, dynamo_color in value_color_map.items():
                
                # Create the base name using the concatenated category prefix
                base_filter_name = '{}_{} {} {}'.format(concatenated_prefix, parameter_name, rule_symbol, value_name)
                
                # Conditionally add the 'DV-' prefix
                if add_prefix:
                    target_filter_name = "DV-" + base_filter_name
                else:
                    target_filter_name = base_filter_name
                
                filter_to_apply = existing_filters.get(target_filter_name)
                
                if filter_to_apply:
                    action_log.append("INFO: Filter '{}' already exists.".format(target_filter_name))
                else:
                    # Create one filter that applies to ALL selected categories
                    new_filter = ParameterFilterElement.Create(doc, target_filter_name, list_ids_categories_net)
                    rule = rule_function(parameter_id, value_name)
                    element_filter = ElementParameterFilter(rule)
                    new_filter.SetElementFilter(element_filter)
                    filter_to_apply = new_filter
                    action_log.append("SUCCESS: Filter '{}' was created.".format(target_filter_name))
                    filters_created_count += 1

                if filter_to_apply and not target_view.IsFilterApplied(filter_to_apply.Id):
                    revit_color = Color(dynamo_color.Red, dynamo_color.Green, dynamo_color.Blue)
                    overrides = OverrideGraphicSettings().SetSurfaceForegroundPatternColor(revit_color).SetSurfaceForegroundPatternId(solid_fill_id)
                    target_view.AddFilter(filter_to_apply.Id)
                    target_view.SetFilterOverrides(filter_to_apply.Id, overrides)
                    action_log.append("  -> SUCCESS: Applied to the view.")
                    filters_applied_count += 1
                elif filter_to_apply:
                    action_log.append("  -> Already applied to the view. No graphic action needed.")

    except Exception as e:
        action_log.append("GENERAL FAILURE: " + str(e))
        
    TransactionManager.Instance.TransactionTaskDone()

    # --- POPUP SECTION ---
    popup_message = "Operation Summary:\n\n- New filters created: {}\n- Filters applied: {}".format(filters_created_count, filters_applied_count)
    popup_title = "Filter Automation Completed"
    MessageBox.Show(popup_message, popup_title, MessageBoxButtons.OK, MessageBoxIcon.Information)

    OUT = action_log
# ----------------------------------------
watch = Watch(python_script_2)
